# Dynamo graph Switches Openings  v 1.0.dyn "Electrical opening v 1.0" (Dynamo 2.12.1.8246)
# packages: Universo_BIM 17.3.21, Rhythm 2023.9.1

categories = Categories("OST_DataDevices")
all_elements_of_category = ElementsOfCategory(Category=categories)
select_model_element = DSModelElementSelection()  # 1 picked in the model
geometry = Element.Geometry(element=select_model_element)
code_block = CodeBlock { 0; 1; 2; 3; }
getItemAtIndex = List.GetItemAtIndex(list=geometry, index=code_block.out0)
getItemAtIndex_2 = List.GetItemAtIndex(list=geometry, index=code_block.out1)
getItemAtIndex_3 = List.GetItemAtIndex(list=geometry, index=code_block.out2)

# group: Familt Data
parameters = Element.Parameters(element=select_model_element)
watch = Watch(parameters)
type = Elements.Element.Type(element=select_model_element)
parameters_2 = Element.Parameters(element=type)
watch_2 = Watch(parameters_2)

categories_2 = Categories("OST_LightingFixtures")
all_elements_of_category_2 = ElementsOfCategory(Category=categories_2)
categories_3 = Categories("OST_FireAlarmDevices")
all_elements_of_category_3 = ElementsOfCategory(Category=categories_3)
code_block_2 = CodeBlock { "13A Normal with USB"; "D50-POWR_1SSO_Normal-G2"; "NP"; }
getItemAtIndex_4 = List.GetItemAtIndex(list=geometry, index=code_block.out3)
watch_3d = Watch3D(getItemAtIndex_4)
select_model_element_2 = DSModelElementSelection()  # 1 picked in the model
code_block_3 = CodeBlock { 3; }
flatten = List.Flatten(amount=code_block_3)  # unwired: list
byGeometry = BoundingBox.ByGeometry(geom=flatten)
toCuboid = BoundingBox.ToCuboid(boundingBox=byGeometry)
width = Cuboid.Width(cuboid=toCuboid)
length = Cuboid.Length(cuboid=toCuboid)
name = Element.Name()  # unwired: element
code_block_4 = CodeBlock { "IWS-V101 16mm"; }
eq = name == code_block_4
filterByBoolMask = List.FilterByBoolMask(mask=eq)  # unwired: list
list_create = List.Create(item0=filterByBoolMask.in)
code_block_5 = CodeBlock { "ID-WA-PAINT_PT-01"; }
eq_2 = name == code_block_5
filterByBoolMask_2 = List.FilterByBoolMask(mask=eq_2)  # unwired: list
list_create_2 = List.Create(item0=filterByBoolMask_2.in)

# group: Walls
categories_4 = Categories("OST_Walls")
all_elements_of_category_4 = ElementsOfCategory(Category=categories_4)
getLocation = Element.GetLocation(element=all_elements_of_category_4)
string_from_object = FromObject(object=getLocation)
code_block_6 = CodeBlock { 0; 4; }
substring = String.Substring(string=string_from_object, startIndex=code_block_6.out0, length=code_block_6.out1)
code_block_7 = CodeBlock { "Line"; }
eq_3 = substring == code_block_7
filterByBoolMask_3 = List.FilterByBoolMask(list=all_elements_of_category_4, mask=eq_3)
getLocation_2 = Element.GetLocation(element=filterByBoolMask_3.in)

# group: Test Location
endPoint = Curve.EndPoint(curve=getLocation_2)
X = Point.X(point=endPoint)
Z = Point.Z(point=endPoint)
startPoint = Curve.StartPoint(curve=getLocation_2)
Z_2 = Point.Z(point=startPoint)
X_2 = Point.X(point=startPoint)
Y = Point.Y(point=endPoint)
Y_2 = Point.Y(point=startPoint)
eq_4 = Y == Y_2
filterByBoolMask_4 = List.FilterByBoolMask(list=filterByBoolMask_3.in, mask=eq_4)

# group: Seprate Walls X
geometry_2 = Element.Geometry(element=filterByBoolMask_4.in)
isEmpty = List.IsEmpty(list=geometry_2@L2)
filterByBoolMask_5 = List.FilterByBoolMask(list=filterByBoolMask_4.in, mask=isEmpty)

# group: Walls X
flatten_2 = List.Flatten(list=filterByBoolMask_5.out)
getLocation_3 = Element.GetLocation(element=flatten_2)
ZAxis = Vector.ZAxis()
code_block_8 = CodeBlock { "Unconnected Height"; }
getParameterValueByName = Element.GetParameterValueByName(element=flatten_2, parameterName=code_block_8)
code_block_9 = CodeBlock(a=getParameterValueByName) { a+2000; }
extrude = Curve.Extrude(curve=getLocation_3, direction=ZAxis, distance=code_block_9)
code_block_10 = CodeBlock { "Width"; }
ʳʰʸᵗʰᵐ_elements = Rhythm.Revit.Elements.Elements.GetParameterValueByNameTypeOrInstance(element=flatten_2, parameterName=code_block_10)
code_block_11 = CodeBlock { true; }
thicken = Surface.Thicken(surface=extrude, thickness=ʳʰʸᵗʰᵐ_elements, both_sides=code_block_11)

# group: Curtin Wall X
flatten_3 = List.Flatten(list=filterByBoolMask_5.in)
getLocation_4 = Element.GetLocation(element=flatten_3)
ZAxis_2 = Vector.ZAxis()
code_block_12 = CodeBlock { "Unconnected Height"; }
getParameterValueByName_2 = Element.GetParameterValueByName(element=flatten_3, parameterName=code_block_12)
code_block_13 = CodeBlock(a=getParameterValueByName_2) { a+2000; }
extrude_2 = Curve.Extrude(curve=getLocation_4, direction=ZAxis_2, distance=code_block_13)
code_block_14 = CodeBlock { 26; }
code_block_15 = CodeBlock { true; }
thicken_2 = Surface.Thicken(surface=extrude_2, thickness=code_block_14, both_sides=code_block_15)

# group: X
walls = List.Create(item0=flatten_2, item1=flatten_3)
flatten_4 = List.Flatten(list=walls)
solids = List.Create(item0=thicken, item1=thicken_2)
flatten_5 = List.Flatten(list=solids)

# group: Electrical Fixtures
categories_5 = Categories("OST_ElectricalFixtures")
all_elements_of_category_5 = ElementsOfCategory(Category=categories_5)
geometry_3 = Element.Geometry(element=all_elements_of_category_5)
volume = Solid.Volume(solid=geometry_3)
maximumItem = List.MaximumItem(list=volume@L2)
eq_5 = volume == maximumItem
filterByBoolMask_6 = List.FilterByBoolMask(list=geometry_3, mask=eq_5)
flatten_6 = List.Flatten(list=filterByBoolMask_6.in)
code_block_16 = CodeBlock { 1; }
chop = List.Chop(list=flatten_6, lengths=code_block_16)

# group: X , Y Glitch Electrical Fixtures
doesIntersect = Geometry.DoesIntersect(geometry=flatten_6, other=flatten_5@L1)
anyTrue = List.AnyTrue(list=doesIntersect@L2)
filterByBoolMask_7 = List.FilterByBoolMask(list=flatten_4, mask=anyTrue)
code_block_17 = CodeBlock { 1; }
chop_2 = List.Chop(list=filterByBoolMask_7.in, lengths=code_block_17)
doesIntersect_2 = Geometry.DoesIntersect(geometry=flatten_6, other=flatten_5@L1)
anyTrue_2 = List.AnyTrue(list=doesIntersect_2@L2)
filterByBoolMask_8 = List.FilterByBoolMask(list=flatten_5, mask=anyTrue_2)
chop_3 = List.Chop(list=filterByBoolMask_8.in, lengths=code_block_17)
doesIntersect_3 = Geometry.DoesIntersect(geometry=flatten_6, other=filterByBoolMask_8.in@L1)
filterByBoolMask_9 = List.FilterByBoolMask(list=flatten_6, mask=doesIntersect_3@L2)
code_block_18 = CodeBlock { 3; }
flatten_7 = List.Flatten(list=filterByBoolMask_9.in@L2, amount=code_block_18)

# group: Wall
flatten_8 = List.Flatten(list=chop_2)
code_block_19 = CodeBlock { 1; }
chop_4 = List.Chop(lengths=code_block_19)  # unwired: list

# group: join
intersectAll = Geometry.IntersectAll(geometry=chop_3, others=flatten_7@L1, lacing=CrossProduct)
code_block_20 = CodeBlock { 4; }
flatten_9 = List.Flatten(list=intersectAll@L4, amount=code_block_20)

# group: Points & Solids
centroid = Solid.Centroid(solid=flatten_9)
pruneDuplicates = Point.PruneDuplicates(points=centroid)
byUnion = Solid.ByUnion(solids=flatten_9)
separate = Solid.Separate(solid=byUnion)

# group: Points
X_3 = Point.X(point=pruneDuplicates)
Y_3 = Point.Y(point=pruneDuplicates)
Z_3 = Point.Z(point=pruneDuplicates)

# group: Data
byGeometry_2 = BoundingBox.ByGeometry(geom=separate@@L1)
toCuboid_2 = BoundingBox.ToCuboid(boundingBox=byGeometry_2)
width_2 = Cuboid.Width(cuboid=toCuboid_2)
code_block_21 = CodeBlock { 2; }
round = Math.Round(number=width_2, digits=code_block_21)
height = Cuboid.Height(cuboid=toCuboid_2)
round_2 = Math.Round(number=height, digits=code_block_21)

# group: Z Coordinate
code_block_22 = CodeBlock { "z has no if"; }
code_block_23 = CodeBlock(z=Z_3, h=round_2) { z-h/2; h; }

# group: Z Coordinate
code_block_24 = CodeBlock { "z has no if"; }
code_block_25 = CodeBlock(z=Z_3, h=round_2) { z+h/2; h; }

# group: X Coordinate
code_block_26 = CodeBlock(x=X_3, w=round) { x+w/2; x; }
code_block_27 = CodeBlock { 1; }
flatten_10 = List.Flatten(list=code_block_26.out0@L2, amount=code_block_27)

# group: Y Coordinate
code_block_28 = CodeBlock(y=Y_3) { y; }
code_block_29 = CodeBlock { 1; }
flatten_11 = List.Flatten(list=code_block_28@L2, amount=code_block_29)

# group: Point 1
byCoordinates = Point.ByCoordinates(x=flatten_10, y=flatten_11, z=code_block_25.out0)

# group: X Coordinate
code_block_30 = CodeBlock(x=X_3, w=round) { x-w/2; x; }
code_block_31 = CodeBlock { 1; }
flatten_12 = List.Flatten(list=code_block_30.out0@L2, amount=code_block_31)

# group: Y Coordinate
code_block_32 = CodeBlock(y=Y_3) { y; }
code_block_33 = CodeBlock { 1; }
flatten_13 = List.Flatten(list=code_block_32@L2, amount=code_block_33)

# group: Point 2
byCoordinates_2 = Point.ByCoordinates(x=flatten_12, y=flatten_13, z=code_block_23.out0)

# group: Opening Wall
wall = Hood.Opening.Wall(wall=flatten_8, point1=byCoordinates, point2=byCoordinates_2)

# group: Seprate Walls Y
geometry_4 = Element.Geometry(element=filterByBoolMask_4.out)
isEmpty_2 = List.IsEmpty(list=geometry_4@L2)
filterByBoolMask_10 = List.FilterByBoolMask(list=filterByBoolMask_4.out, mask=isEmpty_2)

# group: Walls Y
flatten_14 = List.Flatten(list=filterByBoolMask_10.out)
getLocation_5 = Element.GetLocation(element=flatten_14)
ZAxis_3 = Vector.ZAxis()
code_block_34 = CodeBlock { "Unconnected Height"; }
getParameterValueByName_3 = Element.GetParameterValueByName(element=flatten_14, parameterName=code_block_34)
code_block_35 = CodeBlock(a=getParameterValueByName_3) { a+2000; }
extrude_3 = Curve.Extrude(curve=getLocation_5, direction=ZAxis_3, distance=code_block_35)
code_block_36 = CodeBlock { "Width"; }
ʳʰʸᵗʰᵐ_elements_2 = Rhythm.Revit.Elements.Elements.GetParameterValueByNameTypeOrInstance(element=flatten_14, parameterName=code_block_36)
code_block_37 = CodeBlock { true; }
thicken_3 = Surface.Thicken(surface=extrude_3, thickness=ʳʰʸᵗʰᵐ_elements_2, both_sides=code_block_37)

# group: Curtin Wall Y
flatten_15 = List.Flatten(list=filterByBoolMask_10.in)
getLocation_6 = Element.GetLocation(element=flatten_15)
ZAxis_4 = Vector.ZAxis()
code_block_38 = CodeBlock { "Unconnected Height"; }
getParameterValueByName_4 = Element.GetParameterValueByName(element=flatten_15, parameterName=code_block_38)
code_block_39 = CodeBlock(a=getParameterValueByName_4) { a+2000; }
extrude_4 = Curve.Extrude(curve=getLocation_6, direction=ZAxis_4, distance=code_block_39)
code_block_40 = CodeBlock { 26; }
code_block_41 = CodeBlock { true; }
thicken_4 = Surface.Thicken(surface=extrude_4, thickness=code_block_40, both_sides=code_block_41)

# group: Y
solids_2 = List.Create(item0=thicken_3, item1=thicken_4)
flatten_16 = List.Flatten(list=solids_2)
walls_2 = List.Create(item0=flatten_14, item1=flatten_15)
flatten_17 = List.Flatten(list=walls_2)
