# Dynamo graph Switches Openings  v 1.1.dyn "Electrical opening v 1.1" (Dynamo 2.12.1.8246)
# packages: Universo_BIM 17.3.21, Rhythm 2023.9.1

select_model_element = DSModelElementSelection()  # 1 picked in the model
geometry = Element.Geometry(element=select_model_element)
code_block = CodeBlock { 0; 1; 2; 3; }
getItemAtIndex = List.GetItemAtIndex(list=geometry, index=code_block.out0)
getItemAtIndex_2 = List.GetItemAtIndex(list=geometry, index=code_block.out1)
getItemAtIndex_3 = List.GetItemAtIndex(list=geometry, index=code_block.out2)

# group: Familt Data
parameters = Element.Parameters()  # unwired: element
watch = Watch(parameters)
type = Elements.Element.Type()  # unwired: element
parameters_2 = Element.Parameters(element=type)
watch_2 = Watch(parameters_2)

categories = Categories("OST_LightingFixtures")
all_elements_of_category = ElementsOfCategory(Category=categories)
code_block_2 = CodeBlock { "13A Normal with USB"; "D50-POWR_1SSO_Normal-G2"; "NP"; }
getItemAtIndex_4 = List.GetItemAtIndex(list=geometry, index=code_block.out3)
watch_3d = Watch3D(getItemAtIndex_4)
select_model_element_2 = DSModelElementSelection()  # 1 picked in the model
code_block_3 = CodeBlock { 3; }
flatten = List.Flatten(amount=code_block_3)  # unwired: list
byGeometry = BoundingBox.ByGeometry(geom=flatten)
toCuboid = BoundingBox.ToCuboid(boundingBox=byGeometry)
width = Cuboid.Width(cuboid=toCuboid)
length = Cuboid.Length(cuboid=toCuboid)
name = Element.Name()  # unwired: element
code_block_4 = CodeBlock { "IWS-V101 16mm"; }
eq = name == code_block_4
filterByBoolMask = List.FilterByBoolMask(mask=eq)  # unwired: list
list_create = List.Create(item0=filterByBoolMask.in)
code_block_5 = CodeBlock { "ID-WA-PAINT_PT-01"; }
eq_2 = name == code_block_5
filterByBoolMask_2 = List.FilterByBoolMask(mask=eq_2)  # unwired: list
list_create_2 = List.Create(item0=filterByBoolMask_2.in)

# group: Walls
categories_2 = Categories("OST_Walls")
all_elements_of_category_2 = ElementsOfCategory(Category=categories_2)
getLocation = Element.GetLocation(element=all_elements_of_category_2)
string_from_object = FromObject(object=getLocation)
code_block_6 = CodeBlock { 0; 4; }
substring = String.Substring(string=string_from_object, startIndex=code_block_6.out0, length=code_block_6.out1)
code_block_7 = CodeBlock { "Line"; }
eq_3 = substring == code_block_7
filterByBoolMask_3 = List.FilterByBoolMask(list=all_elements_of_category_2, mask=eq_3)
getLocation_2 = Element.GetLocation(element=filterByBoolMask_3.in)

# group: Test Location
endPoint = Curve.EndPoint(curve=getLocation_2)
X = Point.X(point=endPoint)
Z = Point.Z(point=endPoint)
startPoint = Curve.StartPoint(curve=getLocation_2)
Z_2 = Point.Z(point=startPoint)
X_2 = Point.X(point=startPoint)
Y = Point.Y(point=endPoint)
Y_2 = Point.Y(point=startPoint)
eq_4 = Y == Y_2
filterByBoolMask_4 = List.FilterByBoolMask(list=filterByBoolMask_3.in, mask=eq_4)

# group: Seprate Walls X
geometry_2 = Element.Geometry(element=filterByBoolMask_4.in)
isEmpty = List.IsEmpty(list=geometry_2@L2)
filterByBoolMask_5 = List.FilterByBoolMask(list=filterByBoolMask_4.in, mask=isEmpty)

# group: Walls X
flatten_2 = List.Flatten(list=filterByBoolMask_5.out)
getLocation_3 = Element.GetLocation(element=flatten_2)
ZAxis = Vector.ZAxis()
code_block_8 = CodeBlock { "Unconnected Height"; }
getParameterValueByName = Element.GetParameterValueByName(element=flatten_2, parameterName=code_block_8)
code_block_9 = CodeBlock(a=getParameterValueByName) { a+2000; }
extrude = Curve.Extrude(curve=getLocation_3, direction=ZAxis, distance=code_block_9)
code_block_10 = CodeBlock { "Width"; }
ʳʰʸᵗʰᵐ_elements = Rhythm.Revit.Elements.Elements.GetParameterValueByNameTypeOrInstance(element=flatten_2, parameterName=code_block_10)
code_block_11 = CodeBlock { true; }
thicken = Surface.Thicken(surface=extrude, thickness=ʳʰʸᵗʰᵐ_elements, both_sides=code_block_11)

# group: Curtin Wall X
flatten_3 = List.Flatten(list=filterByBoolMask_5.in)
getLocation_4 = Element.GetLocation(element=flatten_3)
ZAxis_2 = Vector.ZAxis()
code_block_12 = CodeBlock { "Unconnected Height"; }
getParameterValueByName_2 = Element.GetParameterValueByName(element=flatten_3, parameterName=code_block_12)
code_block_13 = CodeBlock(a=getParameterValueByName_2) { a+2000; }
extrude_2 = Curve.Extrude(curve=getLocation_4, direction=ZAxis_2, distance=code_block_13)
code_block_14 = CodeBlock { 26; }
code_block_15 = CodeBlock { true; }
thicken_2 = Surface.Thicken(surface=extrude_2, thickness=code_block_14, both_sides=code_block_15)

# group: X
walls = List.Create(item0=flatten_2, item1=flatten_3)
flatten_4 = List.Flatten(list=walls)
solids = List.Create(item0=thicken, item1=thicken_2)
flatten_5 = List.Flatten(list=solids)

# group: Electrical Fixtures
categories_3 = Categories("OST_ElectricalFixtures")
all_elements_of_category_3 = ElementsOfCategory(Category=categories_3)
geometry_3 = Element.Geometry(element=all_elements_of_category_3)
volume = Solid.Volume(solid=geometry_3)
maximumItem = List.MaximumItem(list=volume@L2)
eq_5 = volume == maximumItem
filterByBoolMask_6 = List.FilterByBoolMask(list=geometry_3, mask=eq_5)
flatten_6 = List.Flatten(list=filterByBoolMask_6.in)

# group: Data Devices
categories_4 = Categories("OST_DataDevices")
all_elements_of_category_4 = ElementsOfCategory(Category=categories_4)
geometry_4 = Element.Geometry(element=all_elements_of_category_4)
volume_2 = Solid.Volume(solid=geometry_4)
maximumItem_2 = List.MaximumItem(list=volume_2@L2)
eq_6 = volume_2 == maximumItem_2
filterByBoolMask_7 = List.FilterByBoolMask(list=geometry_4, mask=eq_6)
flatten_7 = List.Flatten(list=filterByBoolMask_7.in)

# group: Fire Alarm
categories_5 = Categories("OST_FireAlarmDevices")
all_elements_of_category_5 = ElementsOfCategory(Category=categories_5)
geometry_5 = Element.Geometry(element=all_elements_of_category_5)
code_block_16 = CodeBlock { 1; }
getItemAtIndex_5 = List.GetItemAtIndex(list=geometry_5@L2, index=code_block_16)
boundingBox = Geometry.BoundingBox(geometry=getItemAtIndex_5)
toCuboid_2 = BoundingBox.ToCuboid(boundingBox=boundingBox)
centroid = Solid.Centroid(solid=toCuboid_2)
code_block_17 = CodeBlock { 86.2; }
byLengths = Cuboid.ByLengths(origin=centroid, width=code_block_17, length=code_block_17, height=code_block_17)
flatten_8 = List.Flatten(list=byLengths)

# group: Wall Voids
list_create_3 = List.Create(item0=flatten_6, item1=flatten_7, item2=flatten_8)
flatten_9 = List.Flatten(list=list_create_3)

# group: X , Y Glitch Electrical Fixtures
doesIntersect = Geometry.DoesIntersect(geometry=flatten_9, other=flatten_5@L1)
anyTrue = List.AnyTrue(list=doesIntersect@L2)
filterByBoolMask_8 = List.FilterByBoolMask(list=flatten_4, mask=anyTrue)
code_block_18 = CodeBlock { 1; }
chop = List.Chop(list=filterByBoolMask_8.in, lengths=code_block_18)
doesIntersect_2 = Geometry.DoesIntersect(geometry=flatten_9, other=flatten_5@L1)
anyTrue_2 = List.AnyTrue(list=doesIntersect_2@L2)
filterByBoolMask_9 = List.FilterByBoolMask(list=flatten_5, mask=anyTrue_2)
chop_2 = List.Chop(list=filterByBoolMask_9.in, lengths=code_block_18)
doesIntersect_3 = Geometry.DoesIntersect(geometry=flatten_9, other=filterByBoolMask_9.in@L1)
filterByBoolMask_10 = List.FilterByBoolMask(list=flatten_9, mask=doesIntersect_3@L2)
code_block_19 = CodeBlock { 3; }
flatten_10 = List.Flatten(list=filterByBoolMask_10.in@L2, amount=code_block_19)

# group: Wall
flatten_11 = List.Flatten(list=chop)

# group: join
intersectAll = Geometry.IntersectAll(geometry=chop_2, others=flatten_10@L1, lacing=CrossProduct)
code_block_20 = CodeBlock { 4; }
flatten_12 = List.Flatten(list=intersectAll@L4, amount=code_block_20)

# group: Points & Solids
centroid_2 = Solid.Centroid(solid=flatten_12)
pruneDuplicates = Point.PruneDuplicates(points=centroid_2)
byUnion = Solid.ByUnion(solids=flatten_12)
separate = Solid.Separate(solid=byUnion)

# group: List Order
X_3 = Point.X(point=pruneDuplicates)
sortIndexByValue = List.SortIndexByValue(list=X_3)
reorder = List.Reorder(list=pruneDuplicates@L2, indices=sortIndexByValue@L2)
centroid_3 = Solid.Centroid(solid=separate)
X_4 = Point.X(point=centroid_3)
sortIndexByValue_2 = List.SortIndexByValue(list=X_4)
reorder_2 = List.Reorder(list=separate@L2, indices=sortIndexByValue_2@L2)

# group: Points
X_5 = Point.X(point=reorder)
Y_3 = Point.Y(point=reorder)
Z_3 = Point.Z(point=reorder)

# group: Data
byGeometry_2 = BoundingBox.ByGeometry(geom=reorder_2@@L1)
toCuboid_3 = BoundingBox.ToCuboid(boundingBox=byGeometry_2)
width_2 = Cuboid.Width(cuboid=toCuboid_3)
code_block_21 = CodeBlock { 2; }
round = Math.Round(number=width_2, digits=code_block_21)
height = Cuboid.Height(cuboid=toCuboid_3)
round_2 = Math.Round(number=height, digits=code_block_21)

# group: Z Coordinate
code_block_22 = CodeBlock { "z has no if"; }
code_block_23 = CodeBlock(z=Z_3, h=round_2) { z-h/2; h; }

# group: Z Coordinate
code_block_24 = CodeBlock { "z has no if"; }
code_block_25 = CodeBlock(z=Z_3, h=round_2) { z+h/2; h; }

# group: X Coordinate
code_block_26 = CodeBlock(x=X_5, w=round) { x+w/2; x; }
code_block_27 = CodeBlock { 1; }
flatten_13 = List.Flatten(list=code_block_26.out0@L2, amount=code_block_27)

# group: Y Coordinate
code_block_28 = CodeBlock(y=Y_3) { y; }
code_block_29 = CodeBlock { 1; }
flatten_14 = List.Flatten(list=code_block_28@L2, amount=code_block_29)

# group: Point 1
byCoordinates = Point.ByCoordinates(x=flatten_13, y=flatten_14, z=code_block_25.out0)

# group: X Coordinate
code_block_30 = CodeBlock(x=X_5, w=round) { x-w/2; x; }
code_block_31 = CodeBlock { 1; }
flatten_15 = List.Flatten(list=code_block_30.out0@L2, amount=code_block_31)

# group: Y Coordinate
code_block_32 = CodeBlock(y=Y_3) { y; }
code_block_33 = CodeBlock { 1; }
flatten_16 = List.Flatten(list=code_block_32@L2, amount=code_block_33)

# group: Point 2
byCoordinates_2 = Point.ByCoordinates(x=flatten_15, y=flatten_16, z=code_block_23.out0)

# group: Opening Wall
wall = Hood.Opening.Wall(wall=flatten_11, point1=byCoordinates, point2=byCoordinates_2)

# group: Seprate Walls Y
geometry_6 = Element.Geometry(element=filterByBoolMask_4.out)
isEmpty_2 = List.IsEmpty(list=geometry_6@L2)
filterByBoolMask_11 = List.FilterByBoolMask(list=filterByBoolMask_4.out, mask=isEmpty_2)

# group: Walls Y
flatten_17 = List.Flatten(list=filterByBoolMask_11.out)
getLocation_5 = Element.GetLocation(element=flatten_17)
ZAxis_3 = Vector.ZAxis()
code_block_34 = CodeBlock { "Unconnected Height"; }
getParameterValueByName_3 = Element.GetParameterValueByName(element=flatten_17, parameterName=code_block_34)
code_block_35 = CodeBlock(a=getParameterValueByName_3) { a+2000; }
extrude_3 = Curve.Extrude(curve=getLocation_5, direction=ZAxis_3, distance=code_block_35)
code_block_36 = CodeBlock { "Width"; }
ʳʰʸᵗʰᵐ_elements_2 = Rhythm.Revit.Elements.Elements.GetParameterValueByNameTypeOrInstance(element=flatten_17, parameterName=code_block_36)
code_block_37 = CodeBlock { true; }
thicken_3 = Surface.Thicken(surface=extrude_3, thickness=ʳʰʸᵗʰᵐ_elements_2, both_sides=code_block_37)

# group: Curtin Wall Y
flatten_18 = List.Flatten(list=filterByBoolMask_11.in)
getLocation_6 = Element.GetLocation(element=flatten_18)
ZAxis_4 = Vector.ZAxis()
code_block_38 = CodeBlock { "Unconnected Height"; }
getParameterValueByName_4 = Element.GetParameterValueByName(element=flatten_18, parameterName=code_block_38)
code_block_39 = CodeBlock(a=getParameterValueByName_4) { a+2000; }
extrude_4 = Curve.Extrude(curve=getLocation_6, direction=ZAxis_4, distance=code_block_39)
code_block_40 = CodeBlock { 26; }
code_block_41 = CodeBlock { true; }
thicken_4 = Surface.Thicken(surface=extrude_4, thickness=code_block_40, both_sides=code_block_41)

# group: Y
walls_2 = List.Create(item0=flatten_17, item1=flatten_18)
flatten_19 = List.Flatten(list=walls_2)
solids_2 = List.Create(item0=thicken_3, item1=thicken_4)
flatten_20 = List.Flatten(list=solids_2)

# group: X , Y Glitch Electrical Fixtures
doesIntersect_4 = Geometry.DoesIntersect(geometry=flatten_9, other=flatten_20@L1)
anyTrue_3 = List.AnyTrue(list=doesIntersect_4@L2)
filterByBoolMask_12 = List.FilterByBoolMask(list=flatten_19, mask=anyTrue_3)
code_block_42 = CodeBlock { 1; }
chop_3 = List.Chop(list=filterByBoolMask_12.in, lengths=code_block_42)
doesIntersect_5 = Geometry.DoesIntersect(geometry=flatten_9, other=flatten_20@L1)
anyTrue_4 = List.AnyTrue(list=doesIntersect_5@L2)
filterByBoolMask_13 = List.FilterByBoolMask(list=flatten_20, mask=anyTrue_4)
chop_4 = List.Chop(list=filterByBoolMask_13.in, lengths=code_block_42)
doesIntersect_6 = Geometry.DoesIntersect(geometry=flatten_9, other=filterByBoolMask_13.in@L1)
filterByBoolMask_14 = List.FilterByBoolMask(list=flatten_9, mask=doesIntersect_6@L2)
code_block_43 = CodeBlock { 3; }
flatten_21 = List.Flatten(list=filterByBoolMask_14.in@L2, amount=code_block_43)

# group: Wall
flatten_22 = List.Flatten(list=chop_3)

# group: join
intersectAll_2 = Geometry.IntersectAll(geometry=chop_4, others=flatten_21@L1, lacing=CrossProduct)
code_block_44 = CodeBlock { 4; }
flatten_23 = List.Flatten(list=intersectAll_2@L4, amount=code_block_44)

# group: Points & Solids
centroid_4 = Solid.Centroid(solid=flatten_23)
pruneDuplicates_2 = Point.PruneDuplicates(points=centroid_4)
byUnion_2 = Solid.ByUnion(solids=flatten_23)
separate_2 = Solid.Separate(solid=byUnion_2)

# group: List Order
Y_4 = Point.Y(point=pruneDuplicates_2)
sortIndexByValue_3 = List.SortIndexByValue(list=Y_4)
reorder_3 = List.Reorder(list=pruneDuplicates_2@L2, indices=sortIndexByValue_3@L2)
centroid_5 = Solid.Centroid(solid=separate_2)
Y_5 = Point.Y(point=centroid_5)
sortIndexByValue_4 = List.SortIndexByValue(list=Y_5)
reorder_4 = List.Reorder(list=separate_2@L2, indices=sortIndexByValue_4@L2)

# group: Points
X_6 = Point.X(point=reorder_3)
Y_6 = Point.Y(point=reorder_3)
Z_4 = Point.Z(point=reorder_3)

# group: X Coordinate
code_block_45 = CodeBlock(x=X_6) { x; }
code_block_46 = CodeBlock { 1; }
flatten_24 = List.Flatten(list=code_block_45@L2, amount=code_block_46)

# group: Data
byGeometry_3 = BoundingBox.ByGeometry(geom=reorder_4@@L1)
toCuboid_4 = BoundingBox.ToCuboid(boundingBox=byGeometry_3)
length_2 = Cuboid.Length(cuboid=toCuboid_4)
code_block_47 = CodeBlock { 2; }
round_3 = Math.Round(number=length_2, digits=code_block_47)
height_2 = Cuboid.Height(cuboid=toCuboid_4)
round_4 = Math.Round(number=height_2, digits=code_block_47)

# group: Y Coordinate
code_block_48 = CodeBlock(y=Y_6, l=round_3) { y+l/2; y; }
code_block_49 = CodeBlock { 1; }
flatten_25 = List.Flatten(list=code_block_48.out0@L2, amount=code_block_49)

# group: Z Coordinate
code_block_50 = CodeBlock(z=Z_4, h=round_4) { z+h/2; h; }
code_block_51 = CodeBlock { "z has no if"; }

# group: Point 1
byCoordinates_3 = Point.ByCoordinates(x=flatten_24, y=flatten_25, z=code_block_50.out0)

# group: X Coordinate
code_block_52 = CodeBlock(x=X_6) { x; }
code_block_53 = CodeBlock { 1; }
flatten_26 = List.Flatten(list=code_block_52@L2, amount=code_block_53)

# group: Y Coordinate
code_block_54 = CodeBlock(y=Y_6, l=round_3) { y-l/2; y; }
code_block_55 = CodeBlock { 1; }
flatten_27 = List.Flatten(list=code_block_54.out0@L2, amount=code_block_55)

# group: Z Coordinate
code_block_56 = CodeBlock(z=Z_4, h=round_4) { z-h/2; h; }
code_block_57 = CodeBlock { "z has no if"; }

# group: Point 2
byCoordinates_4 = Point.ByCoordinates(x=flatten_26, y=flatten_27, z=code_block_56.out0)

# group: Opening Wall
wall_2 = Hood.Opening.Wall(wall=flatten_22, point1=byCoordinates_3, point2=byCoordinates_4)
