# Dynamo graph Switches Openings v 1.2.dyn "Electrical opening v 1.2" (Dynamo 2.12.1.8246)
# packages: Rhythm 2023.9.1, Genius Loci 2023.1.23

# group: Walls
categories = Categories("OST_Walls")
all_elements_of_category = ElementsOfCategory(Category=categories)
getLocation = Element.GetLocation(element=all_elements_of_category)
string_from_object = FromObject(object=getLocation)
code_block = CodeBlock { 0; 4; }
substring = String.Substring(string=string_from_object, startIndex=code_block.out0, length=code_block.out1)
code_block_2 = CodeBlock { "Line"; }
eq = substring == code_block_2
filterByBoolMask = List.FilterByBoolMask(list=all_elements_of_category, mask=eq)
getLocation_2 = Element.GetLocation(element=filterByBoolMask.in)

# group: Test Location
endPoint = Curve.EndPoint(curve=getLocation_2)
X = Point.X(point=endPoint)
Z = Point.Z(point=endPoint)
startPoint = Curve.StartPoint(curve=getLocation_2)
Z_2 = Point.Z(point=startPoint)
X_2 = Point.X(point=startPoint)
Y = Point.Y(point=endPoint)
Y_2 = Point.Y(point=startPoint)
eq_2 = Y == Y_2
filterByBoolMask_2 = List.FilterByBoolMask(list=filterByBoolMask.in, mask=eq_2)

# group: Seprate Walls X
geometry = Element.Geometry(element=filterByBoolMask_2.in)
isEmpty = List.IsEmpty(list=geometry@L2)
filterByBoolMask_3 = List.FilterByBoolMask(list=filterByBoolMask_2.in, mask=isEmpty)

# group: Walls X
flatten = List.Flatten(list=filterByBoolMask_3.out)
getLocation_3 = Element.GetLocation(element=flatten)
ZAxis = Vector.ZAxis()
code_block_3 = CodeBlock { "Unconnected Height"; }
getParameterValueByName = Element.GetParameterValueByName(element=flatten, parameterName=code_block_3)
extrude = Curve.Extrude(curve=getLocation_3, direction=ZAxis, distance=getParameterValueByName)
code_block_4 = CodeBlock { "Width"; }
ʳʰʸᵗʰᵐ_elements = Rhythm.Revit.Elements.Elements.GetParameterValueByNameTypeOrInstance(element=flatten, parameterName=code_block_4)
code_block_5 = CodeBlock { true; }
thicken = Surface.Thicken(surface=extrude, thickness=ʳʰʸᵗʰᵐ_elements, both_sides=code_block_5)

# group: Curtin Wall X
flatten_2 = List.Flatten(list=filterByBoolMask_3.in)
getLocation_4 = Element.GetLocation(element=flatten_2)
ZAxis_2 = Vector.ZAxis()
code_block_6 = CodeBlock { "Unconnected Height"; }
getParameterValueByName_2 = Element.GetParameterValueByName(element=flatten_2, parameterName=code_block_6)
extrude_2 = Curve.Extrude(curve=getLocation_4, direction=ZAxis_2, distance=getParameterValueByName_2)
code_block_7 = CodeBlock { 26; }
code_block_8 = CodeBlock { true; }
thicken_2 = Surface.Thicken(surface=extrude_2, thickness=code_block_7, both_sides=code_block_8)

# group: X
walls = List.Create(item0=flatten, item1=flatten_2)
flatten_3 = List.Flatten(list=walls)
solids = List.Create(item0=thicken, item1=thicken_2)
flatten_4 = List.Flatten(list=solids)

# group: Electrical Fixtures
categories_2 = Categories("OST_ElectricalFixtures")
all_elements_of_category_2 = ElementsOfCategory(Category=categories_2)
geometry_2 = Element.Geometry(element=all_elements_of_category_2)
volume = Solid.Volume(solid=geometry_2)
maximumItem = List.MaximumItem(list=volume@L2)
eq_3 = volume == maximumItem
filterByBoolMask_4 = List.FilterByBoolMask(list=geometry_2, mask=eq_3)
flatten_5 = List.Flatten(list=filterByBoolMask_4.in)

# group: Data Devices
categories_3 = Categories("OST_DataDevices")
all_elements_of_category_3 = ElementsOfCategory(Category=categories_3)
geometry_3 = Element.Geometry(element=all_elements_of_category_3)
volume_2 = Solid.Volume(solid=geometry_3)
maximumItem_2 = List.MaximumItem(list=volume_2@L2)
eq_4 = volume_2 == maximumItem_2
filterByBoolMask_5 = List.FilterByBoolMask(list=geometry_3, mask=eq_4)
flatten_6 = List.Flatten(list=filterByBoolMask_5.in)

# group: Fire Alarm
categories_4 = Categories("OST_FireAlarmDevices")
all_elements_of_category_4 = ElementsOfCategory(Category=categories_4)
geometry_4 = Element.Geometry(element=all_elements_of_category_4)
code_block_9 = CodeBlock { 1; }
getItemAtIndex = List.GetItemAtIndex(list=geometry_4@L2, index=code_block_9)
boundingBox = Geometry.BoundingBox(geometry=getItemAtIndex)
toCuboid = BoundingBox.ToCuboid(boundingBox=boundingBox)
centroid = Solid.Centroid(solid=toCuboid)
code_block_10 = CodeBlock { 86.2; }
byLengths = Cuboid.ByLengths(origin=centroid, width=code_block_10, length=code_block_10, height=code_block_10)
flatten_7 = List.Flatten(list=byLengths)

# group: Wall Voids
list_create = List.Create(item0=flatten_5, item1=flatten_6, item2=flatten_7)
flatten_8 = List.Flatten(list=list_create)
list_clean = Custom[List Clean](list=flatten_8)  # package Genius Loci; Removes all Null, Empty and Blank from a list or nested list of lists.

# group: X , Y Glitch Electrical Fixtures
doesIntersect = Geometry.DoesIntersect(geometry=list_clean, other=flatten_4@L1)
anyTrue = List.AnyTrue(list=doesIntersect@L2)
filterByBoolMask_6 = List.FilterByBoolMask(list=flatten_3, mask=anyTrue)
code_block_11 = CodeBlock { 1; }
chop = List.Chop(list=filterByBoolMask_6.in, lengths=code_block_11)
doesIntersect_2 = Geometry.DoesIntersect(geometry=list_clean, other=flatten_4@L1)
anyTrue_2 = List.AnyTrue(list=doesIntersect_2@L2)
filterByBoolMask_7 = List.FilterByBoolMask(list=flatten_4, mask=anyTrue_2)
chop_2 = List.Chop(list=filterByBoolMask_7.in, lengths=code_block_11)
doesIntersect_3 = Geometry.DoesIntersect(geometry=list_clean, other=filterByBoolMask_7.in@L1)
filterByBoolMask_8 = List.FilterByBoolMask(list=list_clean, mask=doesIntersect_3@L2)
code_block_12 = CodeBlock { 3; }
flatten_9 = List.Flatten(list=filterByBoolMask_8.in@L2, amount=code_block_12)

# group: Wall
flatten_10 = List.Flatten(list=chop)

# group: join
intersectAll = Geometry.IntersectAll(geometry=chop_2, others=flatten_9@L1, lacing=CrossProduct)
code_block_13 = CodeBlock { 4; }
flatten_11 = List.Flatten(list=intersectAll@L4, amount=code_block_13)

# group: Points & Solids
centroid_2 = Solid.Centroid(solid=flatten_11)
pruneDuplicates = Point.PruneDuplicates(points=centroid_2)
byUnion = Solid.ByUnion(solids=flatten_11)
separate = Solid.Separate(solid=byUnion)

# group: List Order
X_3 = Point.X(point=pruneDuplicates)
sortIndexByValue = List.SortIndexByValue(list=X_3)
reorder = List.Reorder(list=pruneDuplicates@L2, indices=sortIndexByValue@L2)
centroid_3 = Solid.Centroid(solid=separate)
X_4 = Point.X(point=centroid_3)
sortIndexByValue_2 = List.SortIndexByValue(list=X_4)
reorder_2 = List.Reorder(list=separate@L2, indices=sortIndexByValue_2@L2)

# group: Points
X_5 = Point.X(point=reorder)
Y_3 = Point.Y(point=reorder)
Z_3 = Point.Z(point=reorder)

# group: Data
byGeometry = BoundingBox.ByGeometry(geom=reorder_2@@L1)
toCuboid_2 = BoundingBox.ToCuboid(boundingBox=byGeometry)
width = Cuboid.Width(cuboid=toCuboid_2)
code_block_14 = CodeBlock { 2; }
round = Math.Round(number=width, digits=code_block_14)
height = Cuboid.Height(cuboid=toCuboid_2)
round_2 = Math.Round(number=height, digits=code_block_14)

# group: Z Coordinate
code_block_15 = CodeBlock { "z has no if"; }
code_block_16 = CodeBlock(z=Z_3, h=round_2) { z-h/2; h; }

# group: Z Coordinate
code_block_17 = CodeBlock { "z has no if"; }
code_block_18 = CodeBlock(z=Z_3, h=round_2) { z+h/2; h; }

# group: X Coordinate
code_block_19 = CodeBlock(x=X_5, w=round) { x+w/2; x; }
code_block_20 = CodeBlock { 1; }
flatten_12 = List.Flatten(list=code_block_19.out0@L2, amount=code_block_20)

# group: Y Coordinate
code_block_21 = CodeBlock(y=Y_3) { y; }
code_block_22 = CodeBlock { 1; }
flatten_13 = List.Flatten(list=code_block_21@L2, amount=code_block_22)

# group: Point 1
byCoordinates = Point.ByCoordinates(x=flatten_12, y=flatten_13, z=code_block_18.out0)

# group: X Coordinate
code_block_23 = CodeBlock(x=X_5, w=round) { x-w/2; x; }
code_block_24 = CodeBlock { 1; }
flatten_14 = List.Flatten(list=code_block_23.out0@L2, amount=code_block_24)

# group: Y Coordinate
code_block_25 = CodeBlock(y=Y_3) { y; }
code_block_26 = CodeBlock { 1; }
flatten_15 = List.Flatten(list=code_block_25@L2, amount=code_block_26)

# group: Point 2
byCoordinates_2 = Point.ByCoordinates(x=flatten_14, y=flatten_15, z=code_block_16.out0)

# group: Opening Wall
wall = Hood.Opening.Wall(wall=flatten_10, point1=byCoordinates, point2=byCoordinates_2)

# group: Seprate Walls Y
geometry_5 = Element.Geometry(element=filterByBoolMask_2.out)
isEmpty_2 = List.IsEmpty(list=geometry_5@L2)
filterByBoolMask_9 = List.FilterByBoolMask(list=filterByBoolMask_2.out, mask=isEmpty_2)

# group: Walls Y
flatten_16 = List.Flatten(list=filterByBoolMask_9.out)
getLocation_5 = Element.GetLocation(element=flatten_16)
ZAxis_3 = Vector.ZAxis()
code_block_27 = CodeBlock { "Unconnected Height"; }
getParameterValueByName_3 = Element.GetParameterValueByName(element=flatten_16, parameterName=code_block_27)
extrude_3 = Curve.Extrude(curve=getLocation_5, direction=ZAxis_3, distance=getParameterValueByName_3)
code_block_28 = CodeBlock { "Width"; }
ʳʰʸᵗʰᵐ_elements_2 = Rhythm.Revit.Elements.Elements.GetParameterValueByNameTypeOrInstance(element=flatten_16, parameterName=code_block_28)
code_block_29 = CodeBlock { true; }
thicken_3 = Surface.Thicken(surface=extrude_3, thickness=ʳʰʸᵗʰᵐ_elements_2, both_sides=code_block_29)

# group: Curtin Wall Y
flatten_17 = List.Flatten(list=filterByBoolMask_9.in)
getLocation_6 = Element.GetLocation(element=flatten_17)
ZAxis_4 = Vector.ZAxis()
code_block_30 = CodeBlock { "Unconnected Height"; }
getParameterValueByName_4 = Element.GetParameterValueByName(element=flatten_17, parameterName=code_block_30)
extrude_4 = Curve.Extrude(curve=getLocation_6, direction=ZAxis_4, distance=getParameterValueByName_4)
code_block_31 = CodeBlock { 26; }
code_block_32 = CodeBlock { true; }
thicken_4 = Surface.Thicken(surface=extrude_4, thickness=code_block_31, both_sides=code_block_32)

# group: Y
walls_2 = List.Create(item0=flatten_16, item1=flatten_17)
flatten_18 = List.Flatten(list=walls_2)
solids_2 = List.Create(item0=thicken_3, item1=thicken_4)
flatten_19 = List.Flatten(list=solids_2)

# group: X , Y Glitch Electrical Fixtures
doesIntersect_4 = Geometry.DoesIntersect(geometry=list_clean, other=flatten_19@L1)
anyTrue_3 = List.AnyTrue(list=doesIntersect_4@L2)
filterByBoolMask_10 = List.FilterByBoolMask(list=flatten_18, mask=anyTrue_3)
code_block_33 = CodeBlock { 1; }
chop_3 = List.Chop(list=filterByBoolMask_10.in, lengths=code_block_33)
doesIntersect_5 = Geometry.DoesIntersect(geometry=list_clean, other=flatten_19@L1)
anyTrue_4 = List.AnyTrue(list=doesIntersect_5@L2)
filterByBoolMask_11 = List.FilterByBoolMask(list=flatten_19, mask=anyTrue_4)
chop_4 = List.Chop(list=filterByBoolMask_11.in, lengths=code_block_33)
doesIntersect_6 = Geometry.DoesIntersect(geometry=list_clean, other=filterByBoolMask_11.in@L1)
filterByBoolMask_12 = List.FilterByBoolMask(list=list_clean, mask=doesIntersect_6@L2)
code_block_34 = CodeBlock { 3; }
flatten_20 = List.Flatten(list=filterByBoolMask_12.in@L2, amount=code_block_34)

# group: Wall
flatten_21 = List.Flatten(list=chop_3)

# group: join
intersectAll_2 = Geometry.IntersectAll(geometry=chop_4, others=flatten_20@L1, lacing=CrossProduct)
code_block_35 = CodeBlock { 4; }
flatten_22 = List.Flatten(list=intersectAll_2@L4, amount=code_block_35)

# group: Points & Solids
centroid_4 = Solid.Centroid(solid=flatten_22)
pruneDuplicates_2 = Point.PruneDuplicates(points=centroid_4)
byUnion_2 = Solid.ByUnion(solids=flatten_22)
separate_2 = Solid.Separate(solid=byUnion_2)

# group: List Order
Y_4 = Point.Y(point=pruneDuplicates_2)
sortIndexByValue_3 = List.SortIndexByValue(list=Y_4)
reorder_3 = List.Reorder(list=pruneDuplicates_2@L2, indices=sortIndexByValue_3@L2)
centroid_5 = Solid.Centroid(solid=separate_2)
Y_5 = Point.Y(point=centroid_5)
sortIndexByValue_4 = List.SortIndexByValue(list=Y_5)
reorder_4 = List.Reorder(list=separate_2@L2, indices=sortIndexByValue_4@L2)

# group: Points
X_6 = Point.X(point=reorder_3)
Y_6 = Point.Y(point=reorder_3)
Z_4 = Point.Z(point=reorder_3)

# group: X Coordinate
code_block_36 = CodeBlock(x=X_6) { x; }
code_block_37 = CodeBlock { 1; }
flatten_23 = List.Flatten(list=code_block_36@L2, amount=code_block_37)

# group: Data
byGeometry_2 = BoundingBox.ByGeometry(geom=reorder_4@@L1)
toCuboid_3 = BoundingBox.ToCuboid(boundingBox=byGeometry_2)
length = Cuboid.Length(cuboid=toCuboid_3)
code_block_38 = CodeBlock { 2; }
round_3 = Math.Round(number=length, digits=code_block_38)
height_2 = Cuboid.Height(cuboid=toCuboid_3)
round_4 = Math.Round(number=height_2, digits=code_block_38)

# group: Y Coordinate
code_block_39 = CodeBlock(y=Y_6, l=round_3) { y+l/2; y; }
code_block_40 = CodeBlock { 1; }
flatten_24 = List.Flatten(list=code_block_39.out0@L2, amount=code_block_40)

# group: Z Coordinate
code_block_41 = CodeBlock(z=Z_4, h=round_4) { z+h/2; h; }
code_block_42 = CodeBlock { "z has no if"; }

# group: Point 1
byCoordinates_3 = Point.ByCoordinates(x=flatten_23, y=flatten_24, z=code_block_41.out0)

# group: X Coordinate
code_block_43 = CodeBlock(x=X_6) { x; }
code_block_44 = CodeBlock { 1; }
flatten_25 = List.Flatten(list=code_block_43@L2, amount=code_block_44)

# group: Y Coordinate
code_block_45 = CodeBlock(y=Y_6, l=round_3) { y-l/2; y; }
code_block_46 = CodeBlock { 1; }
flatten_26 = List.Flatten(list=code_block_45.out0@L2, amount=code_block_46)

# group: Z Coordinate
code_block_47 = CodeBlock(z=Z_4, h=round_4) { z-h/2; h; }
code_block_48 = CodeBlock { "z has no if"; }

# group: Point 2
byCoordinates_4 = Point.ByCoordinates(x=flatten_25, y=flatten_26, z=code_block_47.out0)

# group: Opening Wall
wall_2 = Hood.Opening.Wall(wall=flatten_21, point1=byCoordinates_3, point2=byCoordinates_4)
